# Grasshopper definition Day 3.gh (Grasshopper 1.0.7)

panel = Panel("""1,1
3,1
5,1
7,1
1,2""")
split = TextSplit(Text=graft(panel), Separators=",")  # -> simplify(Result)
split_2 = SplitList(List=split, Index=1)  # -> ListA, ListB

panel_2 = Panel(""".....#............#....#####.##
.#.#....#......#....##.........
......#.#.#.....###.#.#........
......#...#.....#####....#..##.
...#............##...###.##....
#.....#...#....#......##....##.
#...#.#....#..#..##.##...#.....
.......#..........#..#..#.#....
.#.....#.#.......#..#...#....#.
#..#.##.#..................###.
...#.#.##...##.###.....#..#...#
..#.#...#............#.......#.
#..#.#..#.#....#...#.#.....#..#
#......##....#..#.#.#........#.
....#..#.#.#.##............#..#
....#..#..#...#.#.##......#...#
##...#...........#.....###.#...
..#...#.#...#.#.....#....##.##.
....##...##.#....#.....#.##....
#........##......#......#.#.#.#
....#.#.#.........##......#....
.#......#...#.....##..#....#..#
....#..#.#.....#..........#..#.
..##...#..##................#.#
.....#....#.#..#......#........
........#..#.#......#.#........
.....#.#....##.###....#...#....
...##.#.......#....###..#......
............##.#..#...#........
#..###..#.....#.####...........
.......##.....#......#......#..
#........##..#.....##.......#.#
#.##...#...#...#......##..#.#.#
......#....##.#.#...#...##....#
#..#....##.#......#.......##...
.#..........#..........#....#.#
#.....##......##....#..........
..#.#.....#.#...#........#.....
...#........#..#..#.##..##.....
......###.....#..#...#.###...##
.##.##.......#.......###...#...
#.#..#.#.#....#.....###..#...##
......#.##..........#.......##.
#..#.#.........#.....##...##...
..#...#....#....###.#......#...
.....#..#.######.....#..#.#....
..#.#.....#.....##.#....##.#.##
...#.#.#....#....##..#..#.#.##.
...........#.#...#..#..####....
.........#####.#.#.#...#.##.#..
.......#...#......#.##.#.##....
....#.....#.....###..........#.
.#.###....##.#..#..........#...
#...#.........##.....####....#.
##....##...#..........#........
...#.#.#.#....#..........#.....
.......#....#......##.......#..
.#.#..#.........#.#.##....#....
..#.............#..##.#.##..###
.#.##..............#..#..##..#.
..##.#..#......#...##..#.##...#
......#..#....#....#....##..#..
...#...##.............#..###...
...##....#.#.##........#.....##
....#.#.......#..###..#....####
#...#...##..#.####..#...##....#
.......#..#.##..#...#.#........
###.#......#..##..#......#.##..
#....#............#.....#......
..##...#..##......#..#....#....
.#..##...#....#.#...#...#..#..#
........#....###...#..##..###.#
.........#....#....#..#.#.#...#
.#....###.##...#.#...........##
..#..#.#..#.#.##..#...##.......
##..#.#.#....#...#..#..........
#..#.......#....#..##...####...
............#.#..........##.##.
#...#..#.#....#..#.#....##.....
......#...#...#.##............#
#.....##..###..#.#..#.#.##..#.#
#..#.#..#......#.......##.#....
##..#.#..#...#......#.##...###.
.#....#..............#....#.#..
..#.#..##....#....#..##........
.#.#...#..#.....#.#..##........
.....#..#.#......#....#.#..#.#.
....#.###...###.#.#.....#......
...........#.#....##....##.....
..#..#.##..........#...#...#..#
.....#.###.#..........#........
....#....##........###...#.....
.#.....##.......#....#..##..###
#.....#...............##......#
#..#.#..#.#.#.....#.#...#......
.##.###...#....#..........##...
.#.......#.....................
.#.#....#...##..#...#...##.....
.#.#...#.......#.......#...#...
....#.#..#.#..#...#....##......
....##.....#.##....#.##..##..##
..#............#...###.##..#...
.#..#.........#.##....#....#..#
.#..##..#..#........#.#.##.#.##
.###.#...#...............#...#.
...#.##.##.#......#...#....##.#
#......##.......##...###....#.#
#..##.....##......#.#.##....#.#
...#.#....#.#.#...........##..#
#.....##......##.#..........##.
###....#.#...#.#..####.........
.##.#.#...##..#.....#..#...#...
#.....#.#......#..........#.#..
..###.##.#...................#.
#.............#..#........#.##.
#.#.#.#..#.....##..##.#....#...
...#...#..#...#..##..##........
...##...##..#...##...........#.
.####..#.#.#.##.#.......#......
...#....#.......#......#.......
.....#.#...#...#..##..#..#.....
......#.....###.#..#..#.#..###.
.#....#....#..#..##.....##...#.
.#.............##.###.#...#.#..
#..#..#......#.###............#
##.#..##....#..........#.#.#...
......#........#...#.......##..
....#.#..#..........#.....#.#..
...#..#...#.#...#........#.....
.....##...#....#.........##.##.
....#...#...#.##.##...#....#...
.#..#.....##......#..#.#..#....
........##...##.##......#.#.#.#
.................#..#.....##.#.
...#.....#...#.........#..#.#.#
....##.#.....#........#...#..#.
#...............#..#.....#...#.
.....#..#....#...#.####.#.#....
####.#..#.##...#....#...##.....
#...##..#...####..#....#.#...#.
..#.......#.##..##...#.#.......
...........##.......#....#..#..
#.##....#...#.....#....##......
....##.#.......#..#...##.......
...#.........##.#..#......#.###
.#..#..#....#.#.##....###..###.
....#.#........##........##....
....########....#.#.#.###.#...#
...#.###.###.##......##.......#
.#...#.###.......#..........#..
..#..##.........#............#.
.......##.#...#...##...#...#..#
#.##....#.#...#.....#..#.#.....
..#........#..#.#.#.#....#.##..
...#...#.#.........#...#.#..##.
#....#......#.#...........#..##
...#.#.#..#...##...#...#...#...
###..........#.#..........#....
..#....#.#.#.#............#.#..
....#...#..###...#.#....#......
#...........####......##.#.....
..#..##.#...#.....#..#.......##
#.....#..###.....#...##..##....
##..###..##...........#.#...#..
.....#......#..............#...
#..#.##.###.......#.......#...#
#........#....##......#.#......
.#.#.#...#.......#........#.##.
#..#..##.....#...#.#.#.#..###..
.#.#....#..#..#.#....##.#.#....
..#.#.........####.#...#.#.###.
....##........##....#........#.
................#..........#...
..#...................###.##..#
.........#..#..#.#...#....#.#.#
......#.....###.....#.#..#...#.
.#.#.....#..##............##...
...##......##.#....#...........
...##..##..###.#...##..........
....###...#..#.#......#......#.
....##..............#..#..#.#..
####.......#...##.##..#.#......
.#......#.....#....###..#....#.
.#.......#...##...#..##.#......
#.......#.......#.#....#.#.#..#
........#..#..#............##.#
#.#...#.#..##..#.......##..#...
...#....#...#..........##..#...
#.#...#.##....###......##....#.
#..#...###........#..#....#..#.
#....#....###....#..#.......#..
....#.#........#.............#.
.#.##........##...#...#...#...#
#.....##.....#.......#.#.#.....
.#.##..........##..#....#......
.#..##.##.#...##....#.#....##..
........#.#.##.#....#.#..#....#
..#...........................#
.#...........#....#....#.#..#..
........##...........#...#...#.
..#.....#..#......#..##.......#
..#....###..###...#.#.#..#....#
#..#.#...#......##......#......
...........#...##..##....##....
#.#......###..#.....#.......#.#
#.....#....#....#.#...#...#....
....#...#.......#....##.#..#...
.####..##......##.#........#..#
..###..#.#.....#...........##..
..##.#.#..#....#..#..#.........
..........#.#.#####...#........
.###......##.#....#........#...
.....#..#..#.#..#.........#....
..#....#...#...#...##..........
....#..##.#.........##.#..##...
##.####..#...#.#...#.....#..###
..#..#...#...#.....##....#..#.#
#..##..#.....#....#.#.....##..#
...#...........##.....#......#.
......#...#.....#.#..###.......
.........#.....###.##..#...#...
.#...#.##...#..........#.#..##.
......#.......##.....#.....##..
........###..........#...#.....
##.......###..###...##...#.....
#.#.............#..#..#.#......
..##........#.###.....#....##..
......#...#......#....##......#
..#.....#...##...#.......#..#..
..#.###..##.##...#....#...##.#.
........##...#..#.#..##.....#.#
.......................#......#
..##.###......#.#.............#
....#...........###............
##...##.....#.......##.......#.
...#..##..##..#.#.###..#......#
........#........#.#..#..#.....
.#......#....##..........#...#.
.##...........##....#..........
.#..#....###.......#....#..##..
.....###..........#....#.#.#...
...#....###.#.#......#......#..
#.#.##.#.....#..#........#...#.
...#.##.........#..#.....#.....
.##...##......##...###...#.....
...#.....#.##..#...#..#........
........#............#.#.#..##.
###...#.....#...#..#........##.
##...#..#.....#.#....#.#.#.....
#..##.......#...#.#...##..#....
#...#.##.....#.#..#.##......#.#
..#......#.#.#.##.##..........#
..#.##......#.#.#..##..........
....#..#....#..#..............#
..........###.....##..#........
...#.....##.....#..#.#..#...##.
.#..##.#..#....#.#......#.##...
...#.....#..#.#...#..#.....#.#.
#...#.#......##...#..#...#....#
..#.......##...#..#.......#...#
#.....#...........##.#.........
.#......##.....####...#.......#
........#..#.....#.......#..#..
....#.#...##..##...#..#....#...
#.#......#...#.#.###.....#.....
..##...#.#........#.##....#.#.#
.#....#......#.#...###.#.......
.......#.#...##....#.#....#....
.....##..##...#..#.#.....##..#.
.##..#.#.#....##.#...#.....#...
.#..#..##....#.##.......#...#..
....#.##...#..##......#.....#..
.#..#....##....#...............
..##...#.....###...............
..............#.#.##........#.#
.#.#....#....#...#.#........#..
.##...#...#.#....#....#.#.....#
#..............#......#.####.#.
......#...........#..#.....##..
#.#..##.##.....#......#..#.#..#
##.##..#.##.#.............#...#
...#..#......#....#............
........###.#.#..#...#.....#.##
..#.......#.##.........#..#....
...##.#........##...#.#.##..#..
...#..#......#...#....#........
...........#..#..#...##...#....
...#.....#....#..####..##.....#
.......#..#..#......#.........#
#......#........###.....##....#
..#..#..#.#.#....##...##......#
#.#..#..###.#..#.....####......
.#................#####....#...
.#.........#...#.......#......#
..#.......#######........#.....
..#........#.....#..#...#..#..#
.#..#.#..#....#.#..##...#..#.#.
..#...........#.#...#.#.##.....
...#.#.#....##.###....#...####.
.....#..#.....#..#.#.........#.
......##...#...###............#
..#.#......###..####..#......#.
###.##.#..#......##.#..##.....#
....###...##............#.#....
..#.....##...#...##....#...#...
#.....#.....#...#...#.#..#.....
####..........##.#.#..#.....##.
...#..........#...#...##..##.#.
..........#.........#.#..#..#..
#....###.....#.#...#.......##.#
#..#.##.....#..........#...#...
...#.#.###.......##..#.....#...
#...#.#..#.............#..#.#..
#........#.................#..#
..#.#....#.#..##.#...#..#....#.
#...#..........#...###....#...#
......#.............#....#....#
#.#.......##.......#.#....##..#
##...#....#.............#..#...
........#...###.##.#..###.#...#
...##...#..#..#...##..##......#
..#.......##....#.#.##....#....
.....#....#..#.#...##.#.#.....#""")
panel_3 = Panel(""".....#............#....#####.##
.#.#....#......#....##.........
......#.#.#.....###.#.#........
......#...#.....#####....#..##.
...#............##...###.##....
#.....#...#....#......##....##.
#...#.#....#..#..##.##...#.....
.......#..........#..#..#.#....
.#.....#.#.......#..#...#....#.
#..#.##.#..................###.
...#.#.##...##.###.....#..#...#
..#.#...#............#.......#.
#..#.#..#.#....#...#.#.....#..#
#......##....#..#.#.#........#.
....#..#.#.#.##............#..#
....#..#..#...#.#.##......#...#
##...#...........#.....###.#...
..#...#.#...#.#.....#....##.##.
....##...##.#....#.....#.##....
#........##......#......#.#.#.#
....#.#.#.........##......#....
.#......#...#.....##..#....#..#
....#..#.#.....#..........#..#.
..##...#..##................#.#
.....#....#.#..#......#........
........#..#.#......#.#........
.....#.#....##.###....#...#....
...##.#.......#....###..#......
............##.#..#...#........
#..###..#.....#.####...........
.......##.....#......#......#..
#........##..#.....##.......#.#
#.##...#...#...#......##..#.#.#
......#....##.#.#...#...##....#
#..#....##.#......#.......##...
.#..........#..........#....#.#
#.....##......##....#..........
..#.#.....#.#...#........#.....
...#........#..#..#.##..##.....
......###.....#..#...#.###...##
.##.##.......#.......###...#...
#.#..#.#.#....#.....###..#...##
......#.##..........#.......##.
#..#.#.........#.....##...##...
..#...#....#....###.#......#...
.....#..#.######.....#..#.#....
..#.#.....#.....##.#....##.#.##
...#.#.#....#....##..#..#.#.##.
...........#.#...#..#..####....
.........#####.#.#.#...#.##.#..
.......#...#......#.##.#.##....
....#.....#.....###..........#.
.#.###....##.#..#..........#...
#...#.........##.....####....#.
##....##...#..........#........
...#.#.#.#....#..........#.....
.......#....#......##.......#..
.#.#..#.........#.#.##....#....
..#.............#..##.#.##..###
.#.##..............#..#..##..#.
..##.#..#......#...##..#.##...#
......#..#....#....#....##..#..
...#...##.............#..###...
...##....#.#.##........#.....##
....#.#.......#..###..#....####
#...#...##..#.####..#...##....#
.......#..#.##..#...#.#........
###.#......#..##..#......#.##..
#....#............#.....#......
..##...#..##......#..#....#....
.#..##...#....#.#...#...#..#..#
........#....###...#..##..###.#
.........#....#....#..#.#.#...#
.#....###.##...#.#...........##
..#..#.#..#.#.##..#...##.......
##..#.#.#....#...#..#..........
#..#.......#....#..##...####...
............#.#..........##.##.
#...#..#.#....#..#.#....##.....
......#...#...#.##............#
#.....##..###..#.#..#.#.##..#.#
#..#.#..#......#.......##.#....
##..#.#..#...#......#.##...###.
.#....#..............#....#.#..
..#.#..##....#....#..##........
.#.#...#..#.....#.#..##........
.....#..#.#......#....#.#..#.#.
....#.###...###.#.#.....#......
...........#.#....##....##.....
..#..#.##..........#...#...#..#
.....#.###.#..........#........
....#....##........###...#.....
.#.....##.......#....#..##..###
#.....#...............##......#
#..#.#..#.#.#.....#.#...#......
.##.###...#....#..........##...
.#.......#.....................
.#.#....#...##..#...#...##.....
.#.#...#.......#.......#...#...
....#.#..#.#..#...#....##......
....##.....#.##....#.##..##..##
..#............#...###.##..#...
.#..#.........#.##....#....#..#
.#..##..#..#........#.#.##.#.##
.###.#...#...............#...#.
...#.##.##.#......#...#....##.#
#......##.......##...###....#.#
#..##.....##......#.#.##....#.#
...#.#....#.#.#...........##..#
#.....##......##.#..........##.
###....#.#...#.#..####.........
.##.#.#...##..#.....#..#...#...
#.....#.#......#..........#.#..
..###.##.#...................#.
#.............#..#........#.##.
#.#.#.#..#.....##..##.#....#...
...#...#..#...#..##..##........
...##...##..#...##...........#.
.####..#.#.#.##.#.......#......
...#....#.......#......#.......
.....#.#...#...#..##..#..#.....
......#.....###.#..#..#.#..###.
.#....#....#..#..##.....##...#.
.#.............##.###.#...#.#..
#..#..#......#.###............#
##.#..##....#..........#.#.#...
......#........#...#.......##..
....#.#..#..........#.....#.#..
...#..#...#.#...#........#.....
.....##...#....#.........##.##.
....#...#...#.##.##...#....#...
.#..#.....##......#..#.#..#....
........##...##.##......#.#.#.#
.................#..#.....##.#.
...#.....#...#.........#..#.#.#
....##.#.....#........#...#..#.
#...............#..#.....#...#.
.....#..#....#...#.####.#.#....
####.#..#.##...#....#...##.....
#...##..#...####..#....#.#...#.
..#.......#.##..##...#.#.......
...........##.......#....#..#..
#.##....#...#.....#....##......
....##.#.......#..#...##.......
...#.........##.#..#......#.###
.#..#..#....#.#.##....###..###.
....#.#........##........##....
....########....#.#.#.###.#...#
...#.###.###.##......##.......#
.#...#.###.......#..........#..
..#..##.........#............#.
.......##.#...#...##...#...#..#
#.##....#.#...#.....#..#.#.....
..#........#..#.#.#.#....#.##..
...#...#.#.........#...#.#..##.
#....#......#.#...........#..##
...#.#.#..#...##...#...#...#...
###..........#.#..........#....
..#....#.#.#.#............#.#..
....#...#..###...#.#....#......
#...........####......##.#.....
..#..##.#...#.....#..#.......##
#.....#..###.....#...##..##....
##..###..##...........#.#...#..
.....#......#..............#...
#..#.##.###.......#.......#...#
#........#....##......#.#......
.#.#.#...#.......#........#.##.
#..#..##.....#...#.#.#.#..###..
.#.#....#..#..#.#....##.#.#....
..#.#.........####.#...#.#.###.
....##........##....#........#.
................#..........#...
..#...................###.##..#
.........#..#..#.#...#....#.#.#
......#.....###.....#.#..#...#.
.#.#.....#..##............##...
...##......##.#....#...........
...##..##..###.#...##..........
....###...#..#.#......#......#.
....##..............#..#..#.#..
####.......#...##.##..#.#......
.#......#.....#....###..#....#.
.#.......#...##...#..##.#......
#.......#.......#.#....#.#.#..#
........#..#..#............##.#
#.#...#.#..##..#.......##..#...
...#....#...#..........##..#...
#.#...#.##....###......##....#.
#..#...###........#..#....#..#.
#....#....###....#..#.......#..
....#.#........#.............#.
.#.##........##...#...#...#...#
#.....##.....#.......#.#.#.....
.#.##..........##..#....#......
.#..##.##.#...##....#.#....##..
........#.#.##.#....#.#..#....#
..#...........................#
.#...........#....#....#.#..#..
........##...........#...#...#.
..#.....#..#......#..##.......#
..#....###..###...#.#.#..#....#
#..#.#...#......##......#......
...........#...##..##....##....
#.#......###..#.....#.......#.#
#.....#....#....#.#...#...#....
....#...#.......#....##.#..#...
.####..##......##.#........#..#
..###..#.#.....#...........##..
..##.#.#..#....#..#..#.........
..........#.#.#####...#........
.###......##.#....#........#...
.....#..#..#.#..#.........#....
..#....#...#...#...##..........
....#..##.#.........##.#..##...
##.####..#...#.#...#.....#..###
..#..#...#...#.....##....#..#.#
#..##..#.....#....#.#.....##..#
...#...........##.....#......#.
......#...#.....#.#..###.......
.........#.....###.##..#...#...
.#...#.##...#..........#.#..##.
......#.......##.....#.....##..
........###..........#...#.....
##.......###..###...##...#.....
#.#.............#..#..#.#......
..##........#.###.....#....##..
......#...#......#....##......#
..#.....#...##...#.......#..#..
..#.###..##.##...#....#...##.#.
........##...#..#.#..##.....#.#
.......................#......#
..##.###......#.#.............#
....#...........###............
##...##.....#.......##.......#.
...#..##..##..#.#.###..#......#
........#........#.#..#..#.....
.#......#....##..........#...#.
.##...........##....#..........
.#..#....###.......#....#..##..
.....###..........#....#.#.#...
...#....###.#.#......#......#..
#.#.##.#.....#..#........#...#.
...#.##.........#..#.....#.....
.##...##......##...###...#.....
...#.....#.##..#...#..#........
........#............#.#.#..##.
###...#.....#...#..#........##.
##...#..#.....#.#....#.#.#.....
#..##.......#...#.#...##..#....
#...#.##.....#.#..#.##......#.#
..#......#.#.#.##.##..........#
..#.##......#.#.#..##..........
....#..#....#..#..............#
..........###.....##..#........
...#.....##.....#..#.#..#...##.
.#..##.#..#....#.#......#.##...
...#.....#..#.#...#..#.....#.#.
#...#.#......##...#..#...#....#
..#.......##...#..#.......#...#
#.....#...........##.#.........
.#......##.....####...#.......#
........#..#.....#.......#..#..
....#.#...##..##...#..#....#...
#.#......#...#.#.###.....#.....
..##...#.#........#.##....#.#.#
.#....#......#.#...###.#.......
.......#.#...##....#.#....#....
.....##..##...#..#.#.....##..#.
.##..#.#.#....##.#...#.....#...
.#..#..##....#.##.......#...#..
....#.##...#..##......#.....#..
.#..#....##....#...............
..##...#.....###...............
..............#.#.##........#.#
.#.#....#....#...#.#........#..
.##...#...#.#....#....#.#.....#
#..............#......#.####.#.
......#...........#..#.....##..
#.#..##.##.....#......#..#.#..#
##.##..#.##.#.............#...#
...#..#......#....#............
........###.#.#..#...#.....#.##
..#.......#.##.........#..#....
...##.#........##...#.#.##..#..
...#..#......#...#....#........
...........#..#..#...##...#....
...#.....#....#..####..##.....#
.......#..#..#......#.........#
#......#........###.....##....#
..#..#..#.#.#....##...##......#
#.#..#..###.#..#.....####......
.#................#####....#...
.#.........#...#.......#......#
..#.......#######........#.....
..#........#.....#..#...#..#..#
.#..#.#..#....#.#..##...#..#.#.
..#...........#.#...#.#.##.....
...#.#.#....##.###....#...####.
.....#..#.....#..#.#.........#.
......##...#...###............#
..#.#......###..####..#......#.
###.##.#..#......##.#..##.....#
....###...##............#.#....
..#.....##...#...##....#...#...
#.....#.....#...#...#.#..#.....
####..........##.#.#..#.....##.
...#..........#...#...##..##.#.
..........#.........#.#..#..#..
#....###.....#.#...#.......##.#
#..#.##.....#..........#...#...
...#.#.###.......##..#.....#...
#...#.#..#.............#..#.#..
#........#.................#..#
..#.#....#.#..##.#...#..#....#.
#...#..........#...###....#...#
......#.............#....#....#
#.#.......##.......#.#....##..#
##...#....#.............#..#...
........#...###.##.#..###.#...#
...##...#..#..#...##..##......#
..#.......##....#.#.##....#....
.....#....#..#.#...##.#.#.....#""")

lng = ListLength(List=panel_3)
subtraction = Subtraction(A=lng)
series = Series(Start=0, Step=1, Count=subtraction)
item = ListItem(List=panel_3, Index=0, Wrap=True)
multiplication = Multiplication(A=series, B=3)
len = TextLength(Text=item)
mod = Modulus(A=multiplication, B=len)
item_2 = ListItem(List=panel_3, Index=series, Wrap=True)
fragment = TextFragment(Text=item_2, Start=mod, Count=1)
tmatch = MatchText(Text=fragment, Pattern=".", Case=True)
ma = MassAddition(Input=tmatch)  # -> flatten(Result), PartialResults
subtraction_2 = Subtraction(A=lng, B=ma.Result)

lng_2 = ListLength(List=panel_2)
subtraction_3 = Subtraction(A=lng_2)
division = Division(A=subtraction_3, B=split_2.ListB)
round = Round(Number=division)  # -> Nearest, Floor, Ceiling
series_2 = Series(Start=0, Step=1, Count=round.Ceiling)
item_3 = ListItem(List=panel_2, Index=0, Wrap=True)
multiplication_2 = Multiplication(A=series_2, B=split_2.ListB)
multiplication_3 = Multiplication(A=series_2, B=split_2.ListA)
len_2 = TextLength(Text=item_3)
mod_2 = Modulus(A=multiplication_3, B=len_2)
item_4 = ListItem(List=panel_2, Index=multiplication_2, Wrap=True)
fragment_2 = TextFragment(Text=item_4, Start=mod_2, Count=1)
tmatch_2 = MatchText(Text=fragment_2, Pattern=".", Case=True)
lng_3 = ListLength(List=fragment_2)  # -> flatten(Length)
ma_2 = MassAddition(Input=tmatch_2)  # -> flatten(Result), PartialResults
subtraction_4 = Subtraction(A=lng_3, B=ma_2.Result)

panel_4 = Panel(subtraction_2)
panel_5 = Panel(subtraction_4)

split_3 = SplitList(List=panel_5, Index=4)  # -> ListA, ListB
mm = MassMultiplication(Input=split_3.ListA)  # -> Result, PartialResults
len_3 = TextLength(Text=mm.Result)
subtraction_5 = Subtraction(A=len_3, B="5")
fragment_3 = TextFragment(Text=mm.Result, Start=subtraction_5, Count="5")
fragment_4 = TextFragment(Text=mm.Result, Start=0, Count=subtraction_5)
multiplication_4 = Multiplication(A=[fragment_3, fragment_4], B=split_3.ListB)
split_4 = SplitList(List=multiplication_4, Index=1)  # -> ListA, ListB
mod_3 = Modulus(A=split_4.ListA, B=100000)
subtraction_6 = Subtraction(A=split_4.ListA, B=mod_3)
division_2 = Division(A=subtraction_6, B=100000)
addition = Addition(A=division_2, B=split_4.ListB)
len_4 = TextLength(Text=mod_3)
subtraction_7 = Subtraction(A="5", B=len_4)
repeat = RepeatData(Data=0, Length=subtraction_7)
join = TextJoin(Text=flatten([addition, repeat]))
join_2 = TextJoin(Text=flatten([join, mod_3]))

panel_6 = Panel(join_2)
